# Grasshopper definition building-grid-walls-facades-hs24.gh (Grasshopper 1.0.7)

# ----
# Geometry Pipeline
geometry_pipeline = GeometryPipeline(
    GroupByLayer=False,
    GroupByType=False,
    IncludeHidden=True,
    IncludeLocked=True,
    LayerFilter="Geometric_Filter",
    NameFilter="*",
    SublayerFiltering=True,
    TypeFilter=1073741848)
sunion = SolidUnion(Breps=geometry_pipeline)

# ----
# Applying classes to create buildings
mainbeam_class = GhPythonScript()  # -> MainBeam
# ---------- mainbeam_class: Python ----------
class MainBeam(object):
    def __init__(self, geometry, edge):
        self.geometry = geometry
        self.edge = edge
# ---------- end mainbeam_class ----------
# Slab class: Use your Slab class from A03 here!
slab_class = GhPythonScript()  # -> Slab
# ---------- slab_class: Python ----------
# Use your code from A03 here
# ---------- end slab_class ----------
wall_class = GhPythonScript()  # -> Wall
# ---------- wall_class: Python ----------
class Wall(object):
    def __init__(self, geometry, halfface, orientation="S"):
        self.geometry = geometry
        self.halfface = halfface
        self.orientation = orientation
# ---------- end wall_class ----------
column_class = GhPythonScript()  # -> Column
# ---------- column_class: Python ----------
class Column(object):
    def __init__(self, geometry, edge):
        self.geometry = geometry
        self.edge = edge
# ---------- end column_class ----------
buildinggrid_class = GhPythonScript(MainBeam=mainbeam_class, Column=column_class, Slab=slab_class, Wall=wall_class)  # -> BuildingGrid
# ---------- buildinggrid_class: Python ----------
from compas.geometry import Box
from compas.geometry import Frame
from compas.geometry import Line
from compas.geometry import Point
from compas.geometry import Vector
from compas.datastructures import VolMesh


# The building grid class contains both data (attributes)
# of our grid and also its behavior (methods)
class BuildingGrid(object):
    def __init__(self, xsize, ysize, zsize, nx, ny, nz, selected_filter):
        self.volmesh = self.create_volmesh(selected_filter, xsize, ysize, zsize, nx, ny, nz)
        self.columns = []
        self.main_beams = []
        self.slabs = []
        self.walls = []


    def generate_facades(self, facade_thickness):
        # 1. Reset the list of walls and assign facade_thickness to an attribute
        # ... your code here ...
        self.walls = []
        
        # 2. For each face in the volmesh
        # ... your code here ...
        
            # 3. Check if it's in on boundary, otherwise continue to the next face
            # ... your code here ...

            # 4. Get the normal of the face
            # ... your code here ...

            # 5. Calculate the dot product to the unit vector Z
            # ... your code here ...
            
            # 6. If the dot product is zero
            #    ..(ie. the normal is perpendicular to Z -> the face is a vertical one)
            # ... your code here ...

                # 7. Get face points and centroid
                # ... your code here ...

                # 8. Determine width & depth. If the face normal
                #    .. is perpendicular to the Y axis vector,
                #    .. width is along Y, else, it is along X
                #    .. depth will be the difference along Z
                # ... your code here ...

                # 9. Create a box from width, height and depth
                # ... your code here ...

                # 10. Adjust xsize and ysize of geometry to fit based
                #    .. on column_depth_y/column_width_x/main_beam_height 
                # ... your code here ...
                
                # 11. Create frame for facade and move geometry there
                # ... your code here ...
                
                # 12. Append box to list
                # ... your code here ...
                
                # 13. Assign wall orientation based on frame's normal
                # ... your code here ...


    def generate_slabs(self, slab_height):
        # Use your solution from A03 here
        pass
        
    # Generate columns and append them to the self.columns attribute
    def generate_columns(self, column_width_x, column_depth_y):
        self.column_width_x = column_width_x
        self.column_depth_y = column_depth_y
        
        # First reset the list of columns
        self.columns = []

        # Now generate columns
        for uv in self.volmesh.edges():
            # If the edge vector is parallel to unit vector Z...
            edge_vector = self.volmesh.edge_direction(uv)

            if edge_vector.dot(Vector.Zaxis()) in (1, -1):
                # ...we add a column
                edge_midpoint = self.volmesh.edge_point(uv)
                edge_length = self.volmesh.edge_length(uv)

                box = Box(column_width_x, column_depth_y, edge_length)
                box.frame.point = edge_midpoint
                
                column = Column(box, uv)
                self.columns.append(column)
                
     

    # This method is provided as is
    # It shows how to create main beams
    # Main beams are a nbit more complicated than columns
    # because they need to be adjusted in length to match the column
    def generate_main_beams(self, main_beam_width, main_beam_height):
        # First reset the list of main beams
        self.main_beams = []
        self.main_beam_width = main_beam_width
        self.main_beam_height = main_beam_height

        for uv in self.volmesh.edges():
            edge_vector = self.volmesh.edge_direction(uv)

            if edge_vector.dot(Vector.Zaxis()) == 0:

                start, end = self.volmesh.edge_coordinates(uv)
                line = Line(start, end)
                
                # Shorten the beam to fit the columns
                if edge_vector.dot(Vector.Xaxis()) in (1, -1):
                    shift_value = self.column_width_x
                else:
                    shift_value = self.column_depth_y
 
                # Create the box in the origin of world XY frame
                box = Box.from_width_height_depth(main_beam_width, main_beam_height, line.length - shift_value)
                frame = Frame(line.midpoint, edge_vector.cross(Vector.Zaxis()), edge_vector)
                frame.point.z -= main_beam_height / 2
        
                # Move box to correct frame
                box.frame = frame
                
                mainbeam = MainBeam(box, uv)
                self.main_beams.append(mainbeam)

    def create_volmesh(self, selected_filter, xsize, ysize, zsize, nx, ny, nz):
        volmesh = VolMesh()
        vertex_keys = dict()
        
        for ix in range(nx):
            for iy in range(ny):
                for iz in range(nz):
                    corner_1 = Point(ix * xsize, iy * ysize, iz * zsize)
                    corner_2 = Point(corner_1.x + xsize, corner_1.y + ysize, corner_1.z)

                    # Only add cell if within filter
                    if selected_filter.is_included(corner_1, ix, iy, iz):
                        box = Box.from_corner_corner_height(corner_1, corner_2, zsize)
                        corner_points = box.compute_vertices()
                        vertices = []

                        for v in corner_points:
                            gkey = str(v)
                            if gkey not in vertex_keys:
                                vertex_keys[gkey] = volmesh.add_vertex(x=v[0], y=v[1], z=v[2])

                            vertex = vertex_keys[gkey]
                            vertices.append(vertex)

                        a, b, c, d, e, f, g, h = vertices
                        faces = [
                            [a,d,c,b],  # bottom face
                            [a,e,f,d],  # front face
                            [a,b,h,e],  # left face
                            [b,c,g,h],  # back face
                            [d,f,g,c],  # right face
                            [e,h,g,f],  # top face
                        ]

                        # Add the cell with the defined faces
                        volmesh.add_cell(faces, attr_dict=dict(ix=ix, iy=iy, iz=iz))
        
        return volmesh

    def number_of_columns(self):
        return len(self.columns)
    
    def number_of_main_beams(self):
        return len(self.main_beams)

    def calculate_volume(self):
        pass
# ---------- end buildinggrid_class ----------

list = ValueList({"Union": 1, "Intersection": 2}, selected="Intersection")

# ---- group: Options
main_beam_width = Slider(0.35, range=0.1..0.9)
main_beam_height = Slider(0.4, range=0.1..0.9)
column_width_x = Slider(0.35, range=0.1..0.9)
column_depth_y = Slider(0.65, range=0.1..0.9)
slab_height = Slider(0.4, range=0.1..0.9)
facade_thickness = Slider(0.35, range=0.1..0.9)

# ---- group: Grid size
number_slider = Slider(9, range=0..20)
number_slider_2 = Slider(9, range=0..20)
number_slider_3 = Slider(9, range=0..20)

# ---- group: Cell sizes
number_slider_4 = Slider(7, range=0..20)
number_slider_5 = Slider(4.5, range=0..20)
number_slider_6 = Slider(3.5, range=0..20)

# ----
# Filter Classes
# Filter Selection
# Brep Filter: Use your Brep filter from A02 here!
# Brep Filter: Use your merge filter from A02 here!
modulo_filter = GhPythonScript()  # -> mfilter
# ---------- modulo_filter: Python ----------
# Sample filter
class ModuleBasedFilter(object):
    def is_included(self, point, ix, iy, iz):
        if (ix + iy) % 2 == 0:
            return True

        return False

mfilter = ModuleBasedFilter()
# ---------- end modulo_filter ----------
random_filter = GhPythonScript()  # -> rfilter
# ---------- random_filter: Python ----------
# Sample filter
from random import choice

class RandomFilter(object):
    def is_included(self, point, ix, iy, iz):
        return choice([True, False])

rfilter = RandomFilter()
# ---------- end random_filter ----------
linear_filter = GhPythonScript()  # -> lfilter
# ---------- linear_filter: Python ----------
# Sample filter
class LinearFilter(object):
    def __init__(self, coefficient=1, vertical_shift_x=0, vertical_shift_y=0, horizontal_shift_x=0, horizontal_shift_y=0):
        super(LinearFilter, self).__init__()
        self.coefficient = coefficient
        self.vertical_shift_x = vertical_shift_x
        self.vertical_shift_y = vertical_shift_y
        self.horizontal_shift_x = horizontal_shift_x
        self.horizontal_shift_y = horizontal_shift_y

    def is_included(self, point, ix, iy, iz):
        z_range_x = (self.coefficient * ix + self.vertical_shift_x) + self.horizontal_shift_x
        z_range_y = (self.coefficient * iy + self.vertical_shift_y) + self.horizontal_shift_y
        return not z_range_x < iz > z_range_y

lfilter = LinearFilter(coefficient= 1.7, vertical_shift_x= -3, vertical_shift_y=-3, horizontal_shift_x=0, horizontal_shift_y=0)
# ---------- end linear_filter ----------
bfilter = GhPythonScript(brep=sunion)  # -> bfilter; inputs brep: Brep
# ---------- bfilter: Python ----------
"""
Use your implementation of the Brep Filter from A02 here!
"""

# Copy and Paste your solution from A02 here
# [ADD YOUR CODE HERE...]
# ---------- end bfilter ----------
parab_filter = GhPythonScript()  # -> pfilter
# ---------- parab_filter: Python ----------
# Sample filter
class ParaboloidFilter(object):
    def __init__(self, coefficient, horizontal_shift_x, horizontal_shift_y, vertical_shift_x, vertical_shift_y):
        super(ParaboloidFilter, self).__init__()
        self.coefficient = coefficient
        self.vertical_shift_x = vertical_shift_x
        self.vertical_shift_y = vertical_shift_y
        self.horizontal_shift_x = horizontal_shift_x
        self.horizontal_shift_y = horizontal_shift_y


    # Paraboloid filter function
    def is_included(self, point, ix, iy, iz):
        z_paraboloid_x = (self.coefficient * ((ix + self.vertical_shift_x) ** 2 + (iy + self.vertical_shift_y) ** 2)) + self.horizontal_shift_x
        z_paraboloid_y = (self.coefficient * ((iy + self.vertical_shift_x) ** 2 + (ix + self.vertical_shift_x) ** 2)) + self.horizontal_shift_y
    
        # Check if the z value of the point is less than or equal to the z value of the paraboloid
        return z_paraboloid_x > iz < z_paraboloid_y

pfilter = ParaboloidFilter(coefficient=0.2, vertical_shift_x= -4, vertical_shift_y=4, horizontal_shift_x=0, horizontal_shift_y=1)
# ---------- end parab_filter ----------
value_list = ValueList({"Modulo filter": 0, "Random filter": 1, "Linear filter": 2, "Paraboloid filter": 3, "Brep filter": 4, "Merge filter": 5}, selected="Paraboloid filter")

# ---- group: Challenge 02
mfilter = GhPythonScript(filter1=linear_filter, filter2=bfilter, mode=list)  # -> mfilter
# ---------- mfilter: Python ----------
"""
Use your implementation of the Merge Filter from A02 here!
"""

# Copy and Paste your solution from A02 here
# [ADD YOUR CODE HERE...]
# ---------- end mfilter ----------

# ----
stream_filter = StreamFilter(
    Gate=value_list,
    Stream0=modulo_filter,
    Stream1=random_filter,
    Stream2=linear_filter,
    Stream3=parab_filter,
    Stream4=bfilter,
    Stream5=mfilter)

# ----
# Create instance of building grid
filter = Data(stream_filter)
buildinggrid = Data(buildinggrid_class)
# Slab class: Use your code for slab categorization from A03 here
create_building = GhPythonScript(
    nx=number_slider,
    ny=number_slider_2,
    nz=number_slider_3,
    xsize=number_slider_4,
    ysize=number_slider_5,
    zsize=number_slider_6,
    selected_filter=filter,
    main_beam_width=main_beam_width,
    main_beam_height=main_beam_height,
    column_width_x=column_width_x,
    column_depth_y=column_depth_y,
    slab_height=slab_height,
    facade_thickness=facade_thickness,
    BuildingGrid=buildinggrid)  # -> grid; inputs nx: Int32, ny: Int32, nz: Int32
# ---------- create_building: Python ----------
# Create an instance of our building grid
grid = BuildingGrid(xsize, ysize, zsize, nx, ny, nz, selected_filter)

grid.generate_columns(column_width_x, column_depth_y)
grid.generate_main_beams(main_beam_width, main_beam_height)
grid.generate_slabs(slab_height)
grid.generate_facades(facade_thickness)
# ---------- end create_building ----------

# ---- group: Cells
# Visualization
number_slider_7 = Slider(0, range=0..1161)
grid = Data(create_building)
cells = GhPythonScript(i=number_slider_7, grid=grid)  # -> cells
# ---------- cells: Python ----------
from compas_rhino.conversions import mesh_to_rhino

cells = []
for x in grid.volmesh.cells():
    if x < i:
        cells.append(mesh_to_rhino(grid.volmesh.cell_to_mesh(x)))
# ---------- end cells ----------
custom_preview = CustomPreview(Geometry=cells, Material=ColourSwatch(SwatchColor=RGBA(41, 115, 111, 124)))

# ---- group: Columns
columns = GhPythonScript(grid=create_building)  # -> columns
# ---------- columns: Python ----------
# We use this direct conversion instead of the component
# because we want the Box BREP instead of the meshes
from compas_rhino.conversions import box_to_rhino

columns = []

for column in grid.columns:
    column = box_to_rhino(column.geometry)
    columns.append(column)
# ---------- end columns ----------
custom_preview_2 = CustomPreview(Geometry=columns, Material=ColourSwatch(SwatchColor=RGBA(10, 10, 10, 119)))

# ---- group: Main beams
main_beams = GhPythonScript(grid=create_building)  # -> mainbeams
# ---------- main_beams: Python ----------
# We use this direct conversion instead of the component
# because we want the Box BREP instead of the meshes
from compas_rhino.conversions import box_to_rhino

mainbeams = []

for mainbeam in grid.main_beams:
    b = box_to_rhino(mainbeam.geometry)
    mainbeams.append(b)
# ---------- end main_beams ----------
custom_preview_3 = CustomPreview(Geometry=main_beams, Material=ColourSwatch(SwatchColor=RGBA(0, 0, 0, 156)))

# ----
facades = GhPythonScript(grid=create_building)  # -> facades
# ---------- facades: Python ----------
# We use this direct conversion instead of the component
# because we want the Box BREP instead of the meshes
from compas_rhino.conversions import box_to_rhino

facades = []

for wall in grid.walls:
    b = box_to_rhino(wall.geometry)
    facades.append(b)
# ---------- end facades ----------
custom_preview_4 = CustomPreview(Geometry=facades, Material=ColourSwatch(SwatchColor=RGBA(252, 129, 35, 156)))

# ---- group: Attractor-based coloring
attractor_curve = Curve()  # disabled
facades_attractor = GhPythonScript(grid=create_building, curve=attractor_curve)  # -> facades, distances; inputs curve: Curve; disabled
# ---------- facades_attractor: Python ----------
import math
from compas_rhino.conversions import box_to_rhino
from compas_rhino.conversions import curve_to_compas
from compas.geometry import Rotation

# Convert the Rhino input curve to COMPAS (hint: curve_to_compas())
# ... your code here ...

# Create an empty list for facades geometries and distances
# ... your code here ...

# For each facade wall
# ... your code here ...

    # Let's create an alias to the frame of the wall's geometry (box)
    # .. because we are lazy to type too much ;)
    # ... your code here ...

    # Calculate the closest point on curve from the center point of the box (hint: .closest_point() of Curve)
    # ... your code here ...
    
    # Calculate distance to the center point of the box (hint: .distance_to_point() of Point)
    # .. and append to the distances list
    # ... your code here ...
    
    # Copy the shape (box)
    # WHY? Because we will rotate it. If we don't copy, the next time we run this script,
    # .. it will rotate again over the previous rotation!
    # ... your code here ...
   
    # Let's make only the South facade be modified by the attractor
    # ... your code here ...
    
        # Calculate some rotation value
        # You can play around with how to calculate a value that produces nice results
        # ... your code here ...
        
        # Create a Rotation object from axis and angle values.
        # The axis coud be X or Y axis of the box's frame, the angle value is what we calculated above
        # We also need to rotate around the center point of the box (otherwise it rotates around 0, 0, 0)
        # ... your code here ...

        # Finally, we transform the box with our rotation
        # ... your code here ...

    # Convert the box to a rhino geometry and append to the facades list
    # ... your code here ...
# ---------- end facades_attractor ----------
bounds = Bounds(Numbers=facades_attractor.distances)  # disabled
deconstruct_domain = DeconstructDomain(Domain=bounds)  # -> Start, End; disabled
gradient = Gradient(
    LowerLimit=deconstruct_domain.Start,
    UpperLimit=deconstruct_domain.End,
    Parameter=facades_attractor.distances,
    stops=[0.103: RGB(50, 50, 50), 0.628: RGB(190, 190, 190)])  # disabled
custom_preview_5 = CustomPreview(Geometry=facades_attractor.facades, Material=gradient)  # disabled

# ----
merge = Merge(
    Data1=ColourSwatch(SwatchColor=RGBA(0, 0, 0, 104)),
    Data2=ColourSwatch(SwatchColor=RGBA(0, 0, 0, 104)),
    Data3=ColourSwatch(SwatchColor=RGBA(143, 159, 176, 131)))
slabs = GhPythonScript(grid=create_building, available_colors=merge)  # -> slabs, colors; inputs available_colors: list
# ---------- slabs: Python ----------
# We use this direct conversion instead of the component
# because we want the Box BREP instead of the meshes
from compas_rhino.conversions import box_to_rhino

slabs = []
colors = []

for slab in grid.slabs:
    box = box_to_rhino(slab.geometry)
    
    if slab.category == "roof":
        colors.append(available_colors[0])
    elif slab.category == "bottom_slab":
        colors.append(available_colors[1])
    else:
        colors.append(available_colors[2])
        
    slabs.append(box)
# ---------- end slabs ----------
custom_preview_6 = CustomPreview(Geometry=slabs.slabs, Material=slabs.colors)
